# Grasshopper definition ExtendObjectTest.ghx (Grasshopper 1.0.7)
# plug-ins: Speckle 2

list = Accounts(
    {"Account (alan@rynne.es | http://localhost:3000)": "c17e3b5af2f177869a733cca10850355"}, selected="Account (alan@rynne.es | http://localhost:3000)",
    selectedId="c17e3b5af2f177869a733cca10850355",
    selectedServer="http://localhost:3000")
sph = Sphere(Base=PlaneXY(0, 0, 0), Radius=1)
repeat = RepeatData(Data=sph, Length=Slider(100, range=0..100))
panel = Panel("""ABBC
BCDE""")
cso = CreateSpeckleObject(A="/Original", B="/Original", C="/Original")  # -> Debug, SpeckleObject
entwine = Entwine(Branch00=repeat, FlattenInputs=True)
id_9abc86882e = CreateStream(Account=list, stream="9abc86882e http://localhost:3000 c17e3b5af2f177869a733cca10850355")
eso = ExtendSpeckleObject(SpeckleObject=cso.SpeckleObject, Keys=panel, Values=entwine)
create_object_by_key_value = CreateObjectByKeyValue(Keys=panel, Values=entwine)  # -> Object, Debug
eso_2 = ExpandSpeckleObject(SpeckleObject=create_object_by_key_value.Object)  # -> ABBC, BCDE
send = Send(
    Data=eso,
    Stream=id_9abc86882e,
    Branch="main",
    AutoSend=True,
    BaseId="879ad0a971e53b0587189a9ed4c33734",
    CurrentComponentState="up_to_date",
    OutputWrappers="http://localhost:3000\t9abc86882e\td0c7a63127",
    UseDefaultCache=True)  # -> Commits, ObjectId, Data
receive = Receive(
    ID=send.Commits,
    AutoReceive=False,
    CurrentComponentState="expired",
    LastInfoMessage="Alan Rynne @ 2020-10-23T11:50:37.988Z: Grasshopper push. (id:2d55339ff2)",
    ReceivedObjectId="879ad0a971e53b0587189a9ed4c33734",
    StreamWrapper="http://localhost:3000/streams/9abc86882e/commits/d0c7a63127")  # -> Data, Info
eso_3 = ExpandSpeckleObject(SpeckleObject=receive.Data)  # -> A, B, C, ABBC, BCDE
